vi "Main.gviweb"   [G Web Development Software 21.0.0]
panel controls:
  "error in": error
panel indicators:
  "B1C1": T1
types:
  T1 = cluster{"Numeric": f64, "Inflation": f64, "Deflation": f64}
uses:
  WebApp::Function.gvi
  NI::Skyline::TagHTTP::Open Tag.gvi
  NI::Skyline::TagHTTP::Read Tag (DBL).gvi
  NI::Skyline::TagHTTP::Close Tag (Single).gvi
  NI::Skyline::Configuration::Close Configuration.gvi
diagram:
  w1 = $"error in"
  s1 = 0  # shift register
  while {
    Wait(time to wait=1000)
    Increment(x=s1) -> w2
    Decrement(x=s1) -> w3
    Is Greater(x=s1, y=10) -> w4
    call "Function.gvi"(error in=w1) -> (configuration=w5, error out=w6)
    call "Open Tag.gvi"(path="Testing", data type="Double", error in=w6, configuration=w5) -> (tag=w7, error out=w8)
    call "Read Tag (DBL).gvi"(tag in=w7, error in=w8) -> (tag out=w9, value=w10, error out=w11)
    case (w4) {
      frame False {
        Property Node(instance in=T1 {"Numeric"=22, "Inflation"=0, "Deflation"=0}, "Numeric"=w10, "Inflation"=w2, "Deflation"=0) -> (instance out=w12)
        w13 = w2
      }
      frame True {
        Property Node(instance in=T1 {"Numeric"=22, "Inflation"=0, "Deflation"=0}, "Numeric"=w10, "Deflation"=w3, "Inflation"=0) -> (instance out=w12)
        w13 = w3
      }
    }
    $B1C1 <- w12
    call "Close Tag (Single).gvi"(tag=w9, error in=w11) -> (error out=w14)
    call "Close Configuration.gvi"(configuration=w5, error in=w14)
    next s1 = w13
    stop if FALSE
  }
